# Dynamo graph scriptOLD.dyn "script" (Dynamo 2.19.3.6394)
# packages: Data-Shapes 2024.2.114, Genius Loci 2024.2.26, Crumple 2024.4.3, Clockwork for Dynamo 2.x 2.6.0

code_block = CodeBlock { "(Ensure you have Synced before proceeding)"; }
number = DoubleInput(500)
number_2 = DoubleInput(100)

# group: UI
code_block_2 = CodeBlock { "Save a stripped Rvt Model + Coversheet to desktop?"; }
string = StringInput("Confirm")
code_block_3 = CodeBlock { "Yes/No"; }
boolean_input = Custom[Boolean input](InputName=code_block_3, SideText=code_block)  # package Data-Shapes; Creates a boolean input for UI.MultipleInputForm ++ . Check out www.data-shapes.net for more infos!
boolean = BoolSelector(true)
string_2 = StringInput("Cancel")
multipleinputform = Custom[MultipleInputForm ++](Description_optional=code_block_2, ButtonText_optional=string, Inputs=boolean_input, Toggle=boolean, CancelButtonText_optional=string_2, Width_optional=number, LabelWidth_optional=number_2)  # package Data-Shapes; Create a form with multiple inputs. see www.data-shapes.net for tutorials and infos!

code_block_4 = CodeBlock { 0; }
code_block_5 = CodeBlock { 1; }
slice = List.Slice(list=multipleinputform.User_Inputs, start=code_block_4, end=code_block_5)

# group: Find Categorys to delete
categories = Categories("OST_Views")
all_elements_of_category = ElementsOfCategory(Category=categories)
name = Element.Name(element=all_elements_of_category)
list_clean = Custom[List Clean](list=name)  # package Genius Loci; Removes all Null, Empty and Blank from a list or nested list of lists.
string_3 = StringInput("3D Coversheet")
contains = String.Contains(string=list_clean, searchFor=string_3)
filterByBoolMask = List.FilterByBoolMask(list=all_elements_of_category, mask=contains)
categories_2 = Categories("OST_Schedules")
all_elements_of_category_2 = ElementsOfCategory(Category=categories_2)
name_2 = Element.Name(element=all_elements_of_category_2)
string_4 = StringInput("Revision")
contains_2 = String.Contains(string=name_2, searchFor=string_4)
filterByBoolMask_2 = List.FilterByBoolMask(list=all_elements_of_category_2, mask=contains_2)
categories_3 = Categories("OST_Sheets")
all_elements_of_category_3 = ElementsOfCategory(Category=categories_3)
name_3 = Element.Name(element=all_elements_of_category_3)
string_5 = StringInput("CDY REVIT MODEL COVER SHEET")
contains_3 = String.Contains(string=name_3, searchFor=string_5)
filterByBoolMask_3 = List.FilterByBoolMask(list=all_elements_of_category_3, mask=contains_3)
categories_4 = Categories("OST_VolumeOfInterest")
all_elements_of_category_4 = ElementsOfCategory(Category=categories_4)
categories_5 = Categories("OST_ReferenceLines")
all_elements_of_category_5 = ElementsOfCategory(Category=categories_5)
current = Document.Current()
collect_cadlinks = Custom[© Collect.CADLinks](docOrLink=current)  # package Crumple; Return all CAD linked instances as well as their types and owner views.
collect_cadimports = Custom[© Collect.CADImports](docOrLink=current)  # package Crumple; Returns all CAD import instances as well as their type and view.
collect_revitlinks = Custom[© Collect.RevitLinks](docOrLink=current)  # package Crumple; Returns all Revit link types in the current document, as well as all instance elements of those types.
list_create = List.Create(item0=filterByBoolMask.out, item1=filterByBoolMask_2.out, item2=filterByBoolMask_3.out, item3=all_elements_of_category_4, item4=all_elements_of_category_5, item5=collect_cadlinks.instance, item6=collect_cadimports.instance, item7=collect_revitlinks.linkTypes)
flatten = List.Flatten(list=list_create)
watch = Watch(name)
watch_2 = Watch(filterByBoolMask.in)
watch_3 = Watch(filterByBoolMask.out)

# group: Delete and deep purge
code_block_6 = CodeBlock(x=slice) { x[0]; }
code_block_7 = CodeBlock { ""; }
if_ = If(test=code_block_6, true=flatten, false=code_block_7)
watch_4 = Watch(slice)
current_2 = Document.Current()
code_block_8 = CodeBlock { ""; }
boolean_2 = BoolSelector(true)

# group: Get Current Doc Name
current_3 = Document.Current()
filePath = Document.FilePath(document=current_3)
code_block_9 = CodeBlock { 0; }
string_6 = StringInput("\")
lastIndexOf = String.LastIndexOf(string=filePath, searchFor=string_6)
code_block_10 = CodeBlock(X=lastIndexOf) { X+1; }
remove = String.Remove(string=filePath, startIndex=code_block_9, count=code_block_10)
string_7 = StringInput(".rvt")
string_8 = StringInput("")
replace = String.Replace(string=remove, searchFor=string_7, replaceWith=string_8)
watch_5 = Watch(filePath)

flow_waitfor = Custom[© Flow.WaitFor](data=filterByBoolMask_3.in, waitFor=if_)  # package Crumple; Tells the first input to wait for the second input to arrive, then passes on the first input. Really useful for scripts which have branching paths that rely on their outputs to carry each other forward. Quite a few custom packages have a 'passthrough' or 'waitfor' node. I use these all the time, so find it useful to have them contained in this package also.

# group: Get Current Revision
string_9 = StringInput("_Detatched_")
string_10 = StringInput("Current Revision")
getParameterValueByName = Element.GetParameterValueByName(element=flow_waitfor, parameterName=string_10)
watch_6 = Watch(getParameterValueByName)
code_block_11 = CodeBlock(x=watch_6) { x[0]; }
add = string_9 + code_block_11

# group: Combine Names and save as
string_11 = StringInput("C:\Users\")
userName = Custom[System.UserName]()  # package Clockwork for Dynamo 2.x; Returns the user name of the person who is currently logged on to Windows on the machine the script is executed on.
watch_7 = Watch(userName)
add_2 = string_11 + watch_7
string_12 = StringInput("\Desktop\")
add_3 = add_2 + string_12
add_4 = replace + add
add_5 = add_3 + add_4
boolean_3 = BoolSelector(true)

# group: Export Coveesheet PDF
exportPDF = Custom[ExportPDF](DirectoryPath=add_3, view=filterByBoolMask_3.in, Filename=add_4)  # package Genius Loci; Works only in Revit 2022 and later. Exports a selection of views in PDF format.
watch_8 = Watch(exportPDF)

flow_waitfor_2 = Custom[© Flow.WaitFor](data=if_, waitFor=exportPDF)

# group (continued): Delete and deep purge
delete_elements = Custom[Delete Elements](element=flow_waitfor_2)  # package Genius Loci; Delete the input list of elements from the given Revit document. The node returns the number of successfully deleted elements and their Ids as a string. Based on a Springs node
watch_9 = Watch(delete_elements.count)

flow_waitfor_3 = Custom[© Flow.WaitFor](data=slice, waitFor=delete_elements.count)

# group (continued): Delete and deep purge
purge_unused = Custom[Purge Unused](RunIt=flow_waitfor_3, Deeply=flow_waitfor_3)  # package Genius Loci; Purge the document completely including materials an assets using the API. The optional input "deeply" allows to purge unused view templates, unused view filters, imported line Patterns from DWG and "Imports in Families" Object Styles. Can be used with documents open in the background. Works only in Revit 2017 and later.
watch_10 = Watch(purge_unused.Id)
watch_11 = Watch(purge_unused.Count)
flow_waitfor_4 = Custom[© Flow.WaitFor](data=slice, waitFor=purge_unused.Count)
if_2 = If(test=flow_waitfor_4, true=current_2, false=code_block_8)
purgeUnused = Document.PurgeUnused(document=if_2, fullPurge=boolean_2)
watch_12 = Watch(purgeUnused)

# group (continued): Combine Names and save as
flow_waitfor_5 = Custom[© Flow.WaitFor](data=boolean_3, waitFor=purgeUnused)
saveAs = Custom[Document.SaveAs](filePath=add_5, saveAsCentral=flow_waitfor_5)  # package Clockwork for Dynamo 2.x; Saves the active Revit document under the given name.
watch_13 = Watch(saveAs)

watch_14 = Watch(current_2)
watch_15 = Watch(slice)
watch_16 = Watch()  # unwired: arg0
