# Dynamo graph script.dyn (Dynamo 2.19.3.6394)
# packages: Genius Loci 2024.2.26

# group: GET ALL SHEETS AND VIEW ELEMENTS ID
categories = Categories("OST_Sheets")
all_elements_of_category = ElementsOfCategory(Category=categories)
categories_2 = Categories("OST_Views")
all_elements_of_category_2 = ElementsOfCategory(Category=categories_2)
list_create = List.Create(item0=all_elements_of_category, item1=all_elements_of_category_2)

# group: GET ALL TEXT AND FILTER OUT TEXT TO HIDE/REVEAL
categories_3 = Categories("OST_TextNotes")
all_elements_of_category_3 = ElementsOfCategory(Category=categories_3)
typename = TextNote.Typename(textNote=all_elements_of_category_3)
code_block = CodeBlock { "Internal Comment"; }
contains = String.Contains(string=typename, searchFor=code_block)
filterByBoolMask = List.FilterByBoolMask(list=all_elements_of_category_3, mask=contains)

# group: FIND OUT IF ELEMENTS ARE HIDDEN. IF HIDDEN = TRUE, THEN TRIGGER HIDE = FALSE (AKA UNHIDE). IF HIDDEN = FALSE, THEN TRIGGER HIDE = TRUE (AKA HIDE)
isHiddeninView = Element.IsHiddeninView(element=filterByBoolMask.in, view=list_create, lacing=Longest)
flatten = List.Flatten(list=isHiddeninView)
uniqueItems = List.UniqueItems(list=flatten)
isNull = Object.IsNull(object=uniqueItems)
filterByBoolMask_2 = List.FilterByBoolMask(list=uniqueItems, mask=isNull)
boolean = BoolSelector(false)
boolean_2 = BoolSelector(true)
if_ = RefactoredIf(test=filterByBoolMask_2.out, true=boolean, false=boolean_2)

# group: HIDE/REVEAL TEXT IN ALL SHEETS AND VIEWS
view_setelementoverrides = Custom[View SetElementOverrides](view=list_create, elements=filterByBoolMask.in, hide=if_, lacing=CrossProduct)  # package Genius Loci; Overrides element graphics settings in the given view. For use with the Create OverrideGraphicSettings node. Can also be used to hide or unhide elements.
