# Dynamo graph script (1 by 1 User Selection).dyn "script" (Dynamo 2.10.1.3976)
# packages: Crumple 2024.4.3, Genius Loci 2024.2.26, Data-Shapes 2024.2.114

categories = Categories("OST_StructuralFoundation")
list_create = List.Create(item0=categories)
boolean = BoolSelector(true)
select_model_elements_of = Custom[Select Model Elements of Category](Categories=list_create, Toggle=boolean)  # package Data-Shapes; Allows to perform a manual selection with a category filter.

# group: Use element selection
id = Element.Id(element=select_model_elements_of)
element_by_id = ElementById(Id=id)

# group: Order Piles by X and Y co-ordinates (by basepoint)
getLocation = Element.GetLocation(element=element_by_id)
Y = Point.Y(point=getLocation)
number = DoubleInput(3)
round = Math.Round(number=Y, digits=number)
sortByKey = List.SortByKey(list=element_by_id, keys=round)
groupByKey = List.GroupByKey(list=sortByKey.sortedList, keys=sortByKey.sortedKeys)
reverse = List.Reverse(list=groupByKey.groups)
getLocation_2 = Element.GetLocation(element=reverse)
X = Point.X(point=getLocation_2)
number_2 = DoubleInput(3)
round_2 = Math.Round(number=X, digits=number_2)
sortByKey_2 = List.SortByKey(list=reverse, keys=round_2, lacing=Shortest)

# group: Prefix Pile order with "P" and padding (P00X)
flatten = List.Flatten(list=sortByKey_2.sortedList)
string = StringInput("Mark")
count = List.Count(list=flatten)
code_block = CodeBlock(c=count) { (1..c)+""; }
code_block_2 = CodeBlock { 3; }
code_block_3 = CodeBlock { "0"; }
padLeft = String.PadLeft(str=code_block, newWidth=code_block_2, padChars=code_block_3)

code_block_4 = CodeBlock { 4; }
code_block_5 = CodeBlock { "P"; }
padLeft_2 = String.PadLeft(str=padLeft, newWidth=code_block_4, padChars=code_block_5)

# group (continued): Prefix Pile order with "P" and padding (P00X)
setParameterByName = Element.SetParameterByName(element=flatten, parameterName=string, value=padLeft_2)

# group: Type Name must equal
code_block_6 = CodeBlock { "Pile"; }

# group: Search for all "STRUCTURAL FOUNDATIONS" with the type name equalling [REFER TO ORANGE GROUP BELOW] - DISSUSED
element_by_id_2 = ElementById()  # unwired: Id
categories_2 = Categories("OST_StructuralFoundation")
all_elements_of_category = ElementsOfCategory(Category=categories_2)
familytype_name = Custom[© FamilyType.Name](familyTypes=all_elements_of_category)  # package Crumple; For a family type or list of family types, returns the type names.
contains = String.Contains(str=familytype_name, searchFor=code_block_6)
filterByBoolMask = List.FilterByBoolMask(list=all_elements_of_category, mask=contains)
id_2 = Element.Id(element=filterByBoolMask.in)
familytype_name_2 = Custom[© FamilyType.Name](familyTypes=filterByBoolMask.in)

# group: Order Piles by X and Y co-ordinates (by survey point) - DISSUSED
getLocation_3 = Element.GetLocation(element=element_by_id_2)
convert_from_internalorigin = Custom[Convert from InternalOrigin CoordinateSystem](point=getLocation_3)  # package Genius Loci; Get the location point in the 3 coordinate systems : Shared Coordinates, Project Coordinates, Relative Origin Coordinates.
Y_2 = Point.Y(point=convert_from_internalorigin.Point_Survey_System)
number_3 = DoubleInput(3)
round_3 = Math.Round(number=Y_2, digits=number_3)
sortByKey_3 = List.SortByKey(list=element_by_id_2, keys=round_3)
groupByKey_2 = List.GroupByKey(list=sortByKey_3.sortedList, keys=sortByKey_3.sortedKeys)
reverse_2 = List.Reverse(list=groupByKey_2.groups)
getLocation_4 = Element.GetLocation(element=reverse_2)
convert_from_internalorigin_2 = Custom[Convert from InternalOrigin CoordinateSystem](point=getLocation_4)
X_2 = Point.X(point=convert_from_internalorigin_2.Point_Survey_System)
number_4 = DoubleInput(3)
round_4 = Math.Round(number=X_2, digits=number_4)
sortByKey_4 = List.SortByKey(list=reverse_2, keys=round_4, lacing=Shortest)

watch = Watch(code_block)
watch_2 = Watch(padLeft)
watch_3 = Watch(padLeft_2)
watch_4 = Watch(list_create)
watch_5 = Watch(id)
selectmodelelements_data = Custom[SelectModelElements Data]()  # package Data-Shapes; Creates a Revit element selection input for UI.MultipleInputForm++ . Check out www.data-shapes.net for more infos!
