# Dynamo graph script.dyn (Dynamo 2.12.1.8246)
# packages: Genius Loci 2024.2.26, Crumple 2024.4.3

# group: Type Name must equal
code_block = CodeBlock { "Pile"; }

# group: Search for all "STRUCTURAL FOUNDATIONS" with the type name equalling [REFER TO ORANGE GROUP BELOW]
categories = Categories("OST_StructuralFoundation")
all_elements_of_category = ElementsOfCategory(Category=categories)
name = FamilyType.Name(familyType=all_elements_of_category)
contains = String.Contains(string=name, searchFor=code_block)
filterByBoolMask = List.FilterByBoolMask(list=[all_elements_of_category, all_elements_of_category], mask=contains)
id = Element.Id(element=filterByBoolMask.in)
element_by_id = ElementById(Id=id)
name_2 = FamilyType.Name(familyType=filterByBoolMask.in)

# group: Retrieve Coordinates and convert to survey coordinates.
getLocation = Element.GetLocation(element=element_by_id)
convert_from_internalorigin = Custom[Convert from InternalOrigin CoordinateSystem](point=getLocation)  # package Genius Loci; Get the location point in the 3 coordinate systems : Shared Coordinates, Project Coordinates, Relative Origin Coordinates.

# group: Assign Coordinates to parameters
code_block_2 = CodeBlock(p=convert_from_internalorigin.Point_Survey_System) { ["Co-ord X (E/W)","Co-ord Y (N/S)","Co-ord Z (Elev)"]; [p.X, p.Y, p.Z]; }

convert_between_units = DynamoConvert(code_block_2.out1, MeasurementType="Length", FromConversion="Millimeters", ToConversion="Meters")
number = DoubleInput(6)
round = Math.Round(number=convert_between_units, digits=number)

# group (continued): Assign Coordinates to parameters
setParameterByName = Element.SetParameterByName(element=element_by_id@L2, parameterName=code_block_2.out0@L1, value=round@L2, lacing=Longest)

# group: Check Output
watch = Watch(convert_from_internalorigin.Point_Survey_System)
watch_2 = Watch(getLocation)
watch_3 = Watch(code_block_2.out0)
watch_4 = Watch(code_block_2.out1)
watch_5 = Watch(setParameterByName)
watch_6 = Watch(name_2)
watch_7 = Watch(id)
watch_8 = Watch(element_by_id)
watch_9 = Watch(filterByBoolMask.out)

code_block_3 = CodeBlock { "Success!"; }
code_block_4 = CodeBlock { "Co-ordinates accquired for all STRUCTURAL FOUNDATIONS with the TYPE NAME Pile"; }
ui_messenger = Custom[© UI.Messenger](title=code_block_3, body=code_block_4, pass=setParameterByName)  # package Crumple; Displays a message box with a title/body and OK/cancel button. If OK is selected, the third input's data will be passed through.
watch_10 = Watch(convert_between_units)
watch_11 = Watch(round)
