# Dynamo graph script.dyn (Dynamo 2.12.1.8246)
# packages: Data-Shapes 2024.2.114, Crumple 2024.4.3

code_block = CodeBlock { "Pad Renumbering"; }
string = StringInput("Pad Renumbering")
code_block_2 = CodeBlock { "Starting Pad No."; "1"; }
textbox_data = Custom[TextBox Data](InputName=code_block_2.out0, DefaultText=code_block_2.out1)  # package Data-Shapes; Create Data for TextBox input in UI.MultipleInputForm ++ . Check out www.data-shapes.net for more informations
file_path = Filename(".\Pile Numbering Guidance Doc.docx")
code_block_3 = CodeBlock { "Cancel"; }

# group: User Interface + extract user input
code_block_4 = CodeBlock { "Confirm"; }
code_block_5 = CodeBlock { "Pad Prefix"; "Pad"; }
textbox_data_2 = Custom[TextBox Data](InputName=code_block_5.out0, DefaultText=code_block_5.out1)
list_create = List.Create(item0=textbox_data_2, item1=textbox_data)
boolean = BoolSelector(true)
multipleinputform = Custom[MultipleInputForm ++](Description_optional=string, ButtonText_optional=code_block_4, Inputs=list_create, Toggle=boolean, LinkToHelp_optional=file_path, CancelButtonText_optional=code_block_3)  # package Data-Shapes; Create a form with multiple inputs. see www.data-shapes.net for tutorials and infos!
watch = Watch(multipleinputform.User_Inputs)
code_block_6 = CodeBlock { 0; }
code_block_7 = CodeBlock { 1; }
slice = List.Slice(list=watch, start=code_block_6, end=code_block_7)
watch_2 = Watch(slice)
code_block_8 = CodeBlock(X=watch_2) { X[0]; }
watch_3 = Watch(code_block_8)
length = String.Length(string=watch_3)

boolean_2 = BoolSelector(true)
boolean_3 = BoolSelector(false)
if_ = If(test=multipleinputform.Was_Cancelled, true=boolean_2, false=boolean_3)
code_block_9 = CodeBlock { "Process Cancelled by User!"; }

# group: Collect all "STRUCTURAL FOUNDATIONS"
categories = Categories("OST_StructuralFoundation")
all_elements_of_category = ElementsOfCategory(Category=categories)

# group: Filter only foundations with TYPE NAME containing "Pad"
name = Element.Name(element=all_elements_of_category)

string_2 = StringInput("D Pad")
contains = String.Contains(string=name, searchFor=string_2)

# group (continued): Filter only foundations with TYPE NAME containing "Pad"
filterByBoolMask = List.FilterByBoolMask(list=all_elements_of_category, mask=contains)

# group (continued): Collect all "STRUCTURAL FOUNDATIONS"
id = Element.Id(element=filterByBoolMask.in)

element_by_id = ElementById(Id=id)

# group: Order Piles by X and Y co-ordinates (by basepoint)
getLocation = Element.GetLocation(element=element_by_id)
Y = Point.Y(point=getLocation)
number = DoubleInput(3)
round = Math.Round(number=Y, digits=number)
sortByKey = List.SortByKey(list=element_by_id, keys=round)
groupByKey = List.GroupByKey(list=sortByKey.sortedList, keys=sortByKey.sortedKeys)
reverse = List.Reverse(list=groupByKey.groups)
getLocation_2 = Element.GetLocation(element=reverse)
X = Point.X(point=getLocation_2)
number_2 = DoubleInput(3)
round_2 = Math.Round(number=X, digits=number_2)
sortByKey_2 = List.SortByKey(list=reverse, keys=round_2, lacing=Shortest)

flatten = List.Flatten(list=sortByKey_2.sortedList)
code_block_10 = CodeBlock { " Pads successfully renumbered"; }
code_block_11 = CodeBlock { 1; }
code_block_12 = CodeBlock { 2; }
slice_2 = List.Slice(list=watch, start=code_block_11, end=code_block_12)
watch_4 = Watch(slice_2)
code_block_13 = CodeBlock(X=watch_4) { X[0]; }
watch_5 = Watch(code_block_13)
toNumber = String.ToNumber(string=watch_5)
number_3 = DoubleInput(1)
add = length + number_3
code_block_14 = CodeBlock { " "; }
add_2 = watch_3 + code_block_14

# group: Add Prefix and padding (P00X)
count = List.Count(list=flatten)
string_3 = StringInput("Mark")
add_3 = count + toNumber
code_block_15 = CodeBlock(a=toNumber, c=add_3) { (a..c)+""; }
watch_6 = Watch(count)
watch_7 = Watch(code_block_15)

add_4 = count + code_block_10
if_2 = If(test=if_, true=code_block_9, false=add_4)
length_2 = String.Length(string=code_block_15)
add_5 = length_2 + add

# group (continued): Add Prefix and padding (P00X)
padLeft = String.PadLeft(string=code_block_15, newLength=add_5, padChars=add_2)
setParameterByName = Element.SetParameterByName(element=flatten, parameterName=string_3, value=padLeft)

ui_messenger = Custom[© UI.Messenger](title=code_block, body=if_2, pass=setParameterByName)  # package Crumple; Displays a message box with a title/body and OK/cancel button. If OK is selected, the third input's data will be passed through.
watch_8 = Watch(code_block_15)
watch_9 = Watch(id)
watch_10 = Watch(id)
watch_11 = Watch()  # unwired: arg0
watch_12 = Watch(padLeft)
string_4 = StringInput("")
