# Dynamo graph script.dyn (Dynamo 2.16.1.2727)
# packages: Data-Shapes 2024.2.114, Genius Loci 2024.2.26

code_block = CodeBlock { "Input Coordinates"; }
code_block_2 = CodeBlock { "Easting"; "P"; }
textbox_data = Custom[TextBox Data](InputName=code_block_2.out0, DefaultText=code_block_2.out1)  # package Data-Shapes; Create Data for TextBox input in UI.MultipleInputForm ++ . Check out www.data-shapes.net for more informations
code_block_3 = CodeBlock { "Northing"; "P"; }
textbox_data_2 = Custom[TextBox Data](InputName=code_block_3.out0, DefaultText=code_block_3.out1)
code_block_4 = CodeBlock { "Elevation"; "P"; }
textbox_data_3 = Custom[TextBox Data](InputName=code_block_4.out0, DefaultText=code_block_4.out1)
list_create = List.Create(item0=textbox_data, item1=textbox_data_2, item2=textbox_data_3)
boolean = BoolSelector(true)
multipleinputform = Custom[MultipleInputForm ++](Description_optional=code_block, Inputs=list_create, Toggle=boolean)  # package Data-Shapes; Create a form with multiple inputs. see www.data-shapes.net for tutorials and infos!
watch = Watch(multipleinputform.User_Inputs)
code_block_5 = CodeBlock { 0; }
code_block_6 = CodeBlock { 1; }
slice = List.Slice(list=watch, start=code_block_5, end=code_block_6)
watch_2 = Watch(slice)
code_block_7 = CodeBlock(X=watch_2) { X[0]; }
watch_3 = Watch(code_block_7)
toNumber = String.ToNumber(string=watch_3)
code_block_8 = CodeBlock { 1; }
code_block_9 = CodeBlock { 2; }
slice_2 = List.Slice(list=watch, start=code_block_8, end=code_block_9)
watch_4 = Watch(slice_2)
code_block_10 = CodeBlock(X=watch_4) { X[0]; }
watch_5 = Watch(code_block_10)
toNumber_2 = String.ToNumber(string=watch_5)
code_block_11 = CodeBlock { 2; }
code_block_12 = CodeBlock { 3; }
slice_3 = List.Slice(list=watch, start=code_block_11, end=code_block_12)
watch_6 = Watch(slice_3)
code_block_13 = CodeBlock(X=watch_6) { X[0]; }
watch_7 = Watch(code_block_13)
toNumber_3 = String.ToNumber(string=watch_7)
byCoordinates = Point.ByCoordinates(x=toNumber, y=toNumber_2, z=toNumber_3)
code_block_14 = CodeBlock(P=byCoordinates) { x = P.X; y = P.Y; z = P.Z; }
family_types = FamilyTypes("S_CDY_Structural Connection_3D Connection plate:152 Baseplate")
convert_from_projectbasepoint = Custom[Convert from ProjectBasePoint CoordinateSystem](point=byCoordinates)  # package Genius Loci; Convert from Project Base Point Coordinate to Internal Origin Coordinate.
byPoint = FamilyInstance.ByPoint(familyType=family_types, point=convert_from_projectbasepoint)
watch_8 = Watch(byPoint)

# group: Inset at xxx offten from basepoint
watch_9 = Watch(byCoordinates)

# group: <----- distance from basepoint
watch_10 = Watch(convert_from_projectbasepoint)
