# Dynamo graph script.dyn (Dynamo 2.10.1.3976)
# packages: Crumple 2024.4.3

code_block = CodeBlock { "Strip Model"; }
code_block_2 = CodeBlock { "WIP... Watch this space"; }
ui_messenger = Custom[© UI.Messenger](title=code_block, body=code_block_2)  # package Crumple; Displays a message box with a title/body and OK/cancel button. If OK is selected, the third input's data will be passed through.
watch = Watch(ui_messenger)
