# Dynamo graph script.dyn (Dynamo 2.19.3.6394)
# packages: Crumple 2024.4.3, Genius Loci 2024.2.26, Data-Shapes 2024.2.114

element_by_id = ElementById()  # frozen; unwired: Id

# group: Order Piles by X and Y co-ordinates (by survey point) - NOTUSED
getLocation = Element.GetLocation(element=element_by_id)
convert_from_internalorigin = Custom[Convert from InternalOrigin CoordinateSystem](point=getLocation)  # package Genius Loci; Get the location point in the 3 coordinate systems : Shared Coordinates, Project Coordinates, Relative Origin Coordinates.
Y = Point.Y(point=convert_from_internalorigin.Point_Survey_System)
number = DoubleInput(3)
round = Math.Round(number=Y, digits=number)
sortByKey = List.SortByKey(list=element_by_id, keys=round)
groupByKey = List.GroupByKey(list=sortByKey.sortedList, keys=sortByKey.sortedKeys)
reverse = List.Reverse(list=groupByKey.groups)
getLocation_2 = Element.GetLocation(element=reverse)
convert_from_internalorigin_2 = Custom[Convert from InternalOrigin CoordinateSystem](point=getLocation_2)
X = Point.X(point=convert_from_internalorigin_2.Point_Survey_System)
number_2 = DoubleInput(3)
round_2 = Math.Round(number=X, digits=number_2)
sortByKey_2 = List.SortByKey(list=reverse, keys=round_2, lacing=Shortest)  # frozen

code_block = CodeBlock { ""; }

# group: Search for Parameter
code_block_2 = CodeBlock { "Pile Category"; }

code_block_3 = CodeBlock { "Pile Renumbering"; }
code_block_4 = CodeBlock { "Starting Pile No."; "1"; }
textbox_data = Custom[TextBox Data](InputName=code_block_4.out0, DefaultText=code_block_4.out1)  # package Data-Shapes; Create Data for TextBox input in UI.MultipleInputForm ++ . Check out www.data-shapes.net for more informations
file_path = Filename(".\Pile Numbering Guidance Doc.docx")
code_block_5 = CodeBlock { "Cancel"; }
boolean = BoolSelector(true)
boolean_2 = BoolSelector(false)
code_block_6 = CodeBlock { "Process Cancelled by User!"; }
code_block_7 = CodeBlock { " Piles successfully renumbered"; }
code_block_8 = CodeBlock { 2; }
code_block_9 = CodeBlock { 3; }

# group: Collect all "STRUCTURAL FOUNDATIONS"
categories = Categories("OST_StructuralFoundation")
all_elements_of_category = ElementsOfCategory(Category=categories)

# group: Filter only foundations with TYPE NAME "Pile"
name = Element.Name(element=all_elements_of_category)
string = StringInput("Pile")

# group (continued): Collect all "STRUCTURAL FOUNDATIONS"
eq = name == string

# group (continued): Filter only foundations with TYPE NAME "Pile"
filterByBoolMask = List.FilterByBoolMask(list=all_elements_of_category, mask=eq)

# group: First Selection - Drop Down
code_block_10 = CodeBlock { "Select Piles to rename - filtered by parameter 'Pile Category' or ALL"; }
string_2 = StringInput("ALL")
string_3 = StringInput("Pile Category")
getParameterValueByName = Element.GetParameterValueByName(element=filterByBoolMask.in, parameterName=string_3)
uniqueItems = List.UniqueItems(list=getParameterValueByName)
sort = List.Sort(list=uniqueItems)
join = List.Join(list0=string_2, list1=sort)
number_3 = DoubleInput(600)
watch = Watch(join)

eq_2 = join == code_block
watch_2 = Watch(eq_2)
filterByBoolMask_2 = List.FilterByBoolMask(list=join, mask=watch_2)
watch_3 = Watch(filterByBoolMask_2.out)

# group (continued): First Selection - Drop Down
ui_dropdownform = Custom[🐍 UI.DropdownForm](formTitle=code_block_10, keys=watch_3, values=watch_3, formWidth=number_3)  # package Crumple; Creates a basic dropdown form from a set of keys and values. If cancelled, the form will return nothing (null).

getParameterValueByName_2 = Element.GetParameterValueByName(element=filterByBoolMask.in, parameterName=code_block_2)

# group (continued): Collect all "STRUCTURAL FOUNDATIONS"
contains = String.Contains(string=getParameterValueByName_2, searchFor=ui_dropdownform.chosenValue)

# group: CHECK IF "ALL"
string_4 = StringInput("ALL")
eq_3 = string_4 == ui_dropdownform.chosenValue
eq_4 = filterByBoolMask.in == filterByBoolMask.in
flow_waitfor = Custom[© Flow.WaitFor](data=contains, waitFor=eq_3)  # package Crumple; Tells the first input to wait for the second input to arrive, then passes on the first input. Really useful for scripts which have branching paths that rely on their outputs to carry each other forward. Quite a few custom packages have a 'passthrough' or 'waitfor' node. I use these all the time, so find it useful to have them contained in this package also.
if_ = RefactoredIf(test=eq_3, true=eq_4, false=flow_waitfor)

# group (continued): Collect all "STRUCTURAL FOUNDATIONS"
filterByBoolMask_3 = List.FilterByBoolMask(list=filterByBoolMask.in, mask=if_)
familytype_name = Custom[© FamilyType.Name](familyTypes=filterByBoolMask_3.in)  # package Crumple; For a family type or list of family types, returns the type names.
id = Element.Id(element=filterByBoolMask_3.in)

# group: Validate drop down was used + error message
contains_2 = List.Contains(list=watch_3, item=ui_dropdownform.chosenValue)
watch_4 = Watch(contains_2)
string_5 = StringInput("ALL")
eq_5 = ui_dropdownform.chosenValue == string_5
code_block_11 = CodeBlock { "Renumber: "; }
code_block_12 = CodeBlock { "Renumber: Group "; }
if_2 = RefactoredIf(test=eq_5, true=code_block_11, false=code_block_12)
add = if_2 + ui_dropdownform.chosenValue
code_block_13 = CodeBlock { "ERROR! Drop down was not used or Null was selected, Cancel and try again."; }
if_3 = If(test=contains_2, true=add, false=code_block_13)

# group: User Interface + extract user input
code_block_14 = CodeBlock { "Confirm"; }
code_block_15 = CodeBlock { "Pile Prefix"; "P"; }
textbox_data_2 = Custom[TextBox Data](InputName=code_block_15.out0, DefaultText=code_block_15.out1)
code_block_16 = CodeBlock { "Pile No. Padding"; "3"; }
textbox_data_3 = Custom[TextBox Data](InputName=code_block_16.out0, DefaultText=code_block_16.out1)
list_create = List.Create(item0=textbox_data_2, item1=textbox_data_3, item2=textbox_data)
boolean_3 = BoolSelector(true)
multipleinputform = Custom[MultipleInputForm ++](Description_optional=if_3, ButtonText_optional=code_block_14, Inputs=list_create, Toggle=boolean_3, LinkToHelp_optional=file_path, CancelButtonText_optional=code_block_5)  # package Data-Shapes; Create a form with multiple inputs. see www.data-shapes.net for tutorials and infos!
watch_5 = Watch(multipleinputform.User_Inputs)
code_block_17 = CodeBlock { 1; }
code_block_18 = CodeBlock { 2; }
slice = List.Slice(list=watch_5, start=code_block_17, end=code_block_18)
watch_6 = Watch(slice)
code_block_19 = CodeBlock(X=watch_6) { X[0]; }
watch_7 = Watch(code_block_19)
toNumber = String.ToNumber(string=watch_7)
code_block_20 = CodeBlock { 0; }
code_block_21 = CodeBlock { 1; }
slice_2 = List.Slice(list=watch_5, start=code_block_20, end=code_block_21)
watch_8 = Watch(slice_2)
code_block_22 = CodeBlock(X=watch_8) { X[0]; }
watch_9 = Watch(code_block_22)
length = String.Length(string=watch_9)
add_2 = length + toNumber

if_4 = If(test=multipleinputform.Was_Cancelled, true=boolean, false=boolean_2)
element_by_id_2 = ElementById(Id=id)

# group: Order Piles by X and Y co-ordinates (by basepoint)
getLocation_3 = Element.GetLocation(element=element_by_id_2)
Y_2 = Point.Y(point=getLocation_3)
number_4 = DoubleInput(3)
round_3 = Math.Round(number=Y_2, digits=number_4)
sortByKey_3 = List.SortByKey(list=element_by_id_2, keys=round_3)
groupByKey_2 = List.GroupByKey(list=sortByKey_3.sortedList, keys=sortByKey_3.sortedKeys)
reverse_2 = List.Reverse(list=groupByKey_2.groups)
getLocation_4 = Element.GetLocation(element=reverse_2)
X_2 = Point.X(point=getLocation_4)
number_5 = DoubleInput(3)
round_4 = Math.Round(number=X_2, digits=number_5)
sortByKey_4 = List.SortByKey(list=reverse_2, keys=round_4, lacing=Shortest)

flatten = List.Flatten(list=sortByKey_4.sortedList)
slice_3 = List.Slice(list=watch_5, start=code_block_8, end=code_block_9)
watch_10 = Watch(slice_3)
code_block_23 = CodeBlock(X=watch_10) { X[0]; }
watch_11 = Watch(code_block_23)
toNumber_2 = String.ToNumber(string=watch_11)

# group: Add Prefix and padding (P00X)
flatten_2 = List.Flatten(list=flatten)
count = List.Count(list=flatten_2)
string_6 = StringInput("Mark")
add_3 = count + toNumber_2
code_block_24 = CodeBlock(a=toNumber_2, c=add_3) { (a..c)+""; }
code_block_25 = CodeBlock { "0"; }
padLeft = String.PadLeft(string=code_block_24, newLength=toNumber, padChars=code_block_25)
padLeft_2 = String.PadLeft(string=padLeft, newLength=add_2, padChars=watch_9)
setParameterByName = Element.SetParameterByName(element=flatten_2, parameterName=string_6, value=padLeft_2)
watch_12 = Watch(count)
watch_13 = Watch(code_block_24)

add_4 = count + code_block_7
if_5 = If(test=if_4, true=code_block_6, false=add_4)
ui_messenger = Custom[© UI.Messenger](title=code_block_3, body=if_5, pass=setParameterByName)  # package Crumple; Displays a message box with a title/body and OK/cancel button. If OK is selected, the third input's data will be passed through.
watch_14 = Watch(code_block_24)
