# Dynamo graph script.dyn (Dynamo 3.3.0.6316)
# packages: Crumple 2024.4.3, Genius Loci 2024.2.26

# group: Search for all "STRUCTURAL FOUNDATIONS" with the type name equalling [REFER TO ORANGE GROUP BELOW]
categories = Categories("OST_StructuralFoundation")
all_elements_of_category = ElementsOfCategory(Category=categories)
name = FamilyType.Name(familyType=all_elements_of_category)

# group: Type Name must equal
code_block = CodeBlock { "Pile"; }

eq = name == code_block

# group (continued): Search for all "STRUCTURAL FOUNDATIONS" with the type name equalling [REFER TO ORANGE GROUP BELOW]
filterByBoolMask = List.FilterByBoolMask(list=[all_elements_of_category, all_elements_of_category], mask=eq)
id = Element.Id(element=filterByBoolMask.in)
element_by_id = ElementById(Id=id)

# group: Retrieve Coordinates and convert to survey coordinates.
getLocation = Element.GetLocation(element=element_by_id)
convert_from_internalorigin = Custom[Convert from InternalOrigin CoordinateSystem](point=getLocation)  # package Genius Loci; Get the location point in the 3 coordinate systems : Shared Coordinates, Project Coordinates, Relative Origin Coordinates.

flatten = List.Flatten(list=convert_from_internalorigin.Point_Survey_System)

# group: Compare custom parameters to survey point
string = StringInput("Co-ord X (E/W)")
getParameterValueByName = Element.GetParameterValueByName(element=element_by_id, parameterName=string)
code_block_2 = CodeBlock { ""; }
eq_2 = getParameterValueByName == code_block_2
filterByBoolMask_2 = List.FilterByBoolMask(list=element_by_id, mask=eq_2)
code_block_3 = CodeBlock { 0; }
setParameterByName = Element.SetParameterByName(element=filterByBoolMask_2.in, parameterName=string, value=code_block_3)
flow_waitfor = Custom[© Flow.WaitFor](data=getParameterValueByName, waitFor=setParameterByName)  # package Crumple; Tells the first input to wait for the second input to arrive, then passes on the first input. Really useful for scripts which have branching paths that rely on their outputs to carry each other forward. Quite a few custom packages have a 'passthrough' or 'waitfor' node. I use these all the time, so find it useful to have them contained in this package also.
code_block_4 = CodeBlock(p=flatten) { [p.X]; }
code_block_5 = CodeBlock(X=code_block_4) { X[0]; }
eq_3 = Equals(x=flow_waitfor, y=code_block_5)
string_2 = StringInput("Co-ord Y (N/S)")
getParameterValueByName_2 = Element.GetParameterValueByName(element=element_by_id, parameterName=string_2)
code_block_6 = CodeBlock { ""; }
eq_4 = getParameterValueByName_2 == code_block_6
filterByBoolMask_3 = List.FilterByBoolMask(list=element_by_id, mask=eq_4)
code_block_7 = CodeBlock { 0; }
setParameterByName_2 = Element.SetParameterByName(element=filterByBoolMask_3.in, parameterName=string_2, value=code_block_7)
flow_waitfor_2 = Custom[© Flow.WaitFor](data=getParameterValueByName_2, waitFor=setParameterByName_2)
code_block_8 = CodeBlock(p=flatten) { [p.Y]; }
code_block_9 = CodeBlock(X=code_block_8) { X[0]; }
eq_5 = Equals(x=flow_waitfor_2, y=code_block_9)
string_3 = StringInput("Co-ord Z (Elev)")
getParameterValueByName_3 = Element.GetParameterValueByName(element=element_by_id, parameterName=string_3)
code_block_10 = CodeBlock(p=flatten) { [p.Z]; }
code_block_11 = CodeBlock(X=code_block_10) { X[0]; }

watch = Watch(eq_3)
watch_2 = Watch(eq_5)
code_block_12 = CodeBlock { ""; }
eq_6 = getParameterValueByName_3 == code_block_12
filterByBoolMask_4 = List.FilterByBoolMask(list=element_by_id, mask=eq_6)
code_block_13 = CodeBlock { 0; }
setParameterByName_3 = Element.SetParameterByName(element=filterByBoolMask_4.in, parameterName=string_3, value=code_block_13)
flow_waitfor_3 = Custom[© Flow.WaitFor](data=getParameterValueByName_3, waitFor=setParameterByName_3)

# group (continued): Compare custom parameters to survey point
eq_7 = Equals(x=flow_waitfor_3, y=code_block_11)

watch_3 = Watch(eq_7)

# group: Check if any results fails and decide output message
code_block_14 = CodeBlock { "Checking Pile Coordinates..."; }
list_create = List.Create(item0=watch, item1=watch_2, item2=watch_3)
flatten_2 = List.Flatten(list=list_create)
uniqueItems = List.UniqueItems(list=flatten_2)
boolean = BoolSelector(false)
contains = List.Contains(list=uniqueItems, item=boolean)
boolean_2 = BoolSelector(false)
string_4 = StringInput("Pile Coordinates are out of date!")
string_5 = StringInput("Pile Coordinates are up to date!")

isNull = Object.IsNull(object=contains)
watch_4 = Watch(isNull)
boolean_3 = BoolSelector(true)
if_ = RefactoredIf(test=watch_4, true=boolean_3, false=boolean_2)
watch_5 = Watch(if_)

# group (continued): Check if any results fails and decide output message
or_ = Or(bool0=watch_5, bool1=contains)
if_2 = RefactoredIf(test=or_, true=string_4, false=string_5)
ui_messenger = Custom[© UI.Messenger](title=code_block_14, body=if_2)  # package Crumple; Displays a message box with a title/body and OK/cancel button. If OK is selected, the third input's data will be passed through.

watch_6 = Watch(code_block_9)
watch_7 = Watch(element_by_id)

# group: Write to Pile Comments if E+N+Z Correct/Incorrect
filterByBoolMask_5 = List.FilterByBoolMask(list=element_by_id, mask=eq_3)
filterByBoolMask_6 = List.FilterByBoolMask(list=element_by_id, mask=eq_5)
filterByBoolMask_7 = List.FilterByBoolMask(list=element_by_id, mask=eq_7)
list_create_2 = List.Create(item0=filterByBoolMask_5.out, item1=filterByBoolMask_6.out, item2=filterByBoolMask_7.out)
flatten_3 = List.Flatten(list=list_create_2)
string_6 = StringInput("Comments")
parameterByName = Parameter.ParameterByName(element=flatten_3, name=string_6)
list_create_3 = List.Create(item0=filterByBoolMask_5.in, item1=filterByBoolMask_6.in, item2=filterByBoolMask_7.in)
string_7 = StringInput("Comments")
parameterByName_2 = Parameter.ParameterByName(element=list_create_3, name=string_7)
string_8 = StringInput("E+N Correct")
setValue = Parameter.SetValue(parameter=parameterByName_2, value=string_8)
flow_waitfor_4 = Custom[© Flow.WaitFor](data=parameterByName, waitFor=setValue)
string_9 = StringInput("E+N Incorrect")
setValue_2 = Parameter.SetValue(parameter=flow_waitfor_4, value=string_9)

watch_8 = Watch(flatten)
watch_9 = Watch(flatten_3)
watch_10 = Watch(or_)
