# Dynamo graph script.dyn (Dynamo 2.19.3.6394)
# packages: Data-Shapes 2024.2.114, Genius Loci 2024.2.26, Crumple 2024.4.3

# group: Get ALL Piles in Model
categories = Categories("OST_StructuralFoundation")
all_elements_of_category = ElementsOfCategory(Category=categories)
name = FamilyType.Name(familyType=all_elements_of_category)
code_block = CodeBlock { "Pile"; }
eq = name == code_block
filterByBoolMask = List.FilterByBoolMask(list=all_elements_of_category, mask=eq)

# group: Get ALL Piles in View
current = Document.Current()
activeView = Document.ActiveView(document=current)
all_elements_in_view_s = Custom[All Elements In View(s)](Views=activeView)  # package Data-Shapes; Retrieves all visible element in a view or a set of views
flatten = List.Flatten(list=all_elements_in_view_s)
name_2 = FamilyType.Name(familyType=flatten)
code_block_2 = CodeBlock { "Pile"; }
eq_2 = name_2 == code_block_2
filterByBoolMask_2 = List.FilterByBoolMask(list=flatten, mask=eq_2)

# group: Create View to Show Missing
setDifference = List.SetDifference(list1=filterByBoolMask.in, list2=filterByBoolMask_2.in)
show_element = Custom[Show Element](element=setDifference)  # package Genius Loci; Shows the given elements by zoom to fit in a view and select them.
color_palette = ColorPalette({R: 255, G: 0, B: 0, A: 255})
overrideColorInView = Element.OverrideColorInView(element=setDifference, color=color_palette)
code_block_3 = CodeBlock { "Piles Missing From View"; }
n3dview_create = Custom[3DView Create](ViewName=code_block_3)  # package Genius Loci; Creates a new isometric View3D in the given document.
views_open = Custom[© Views.Open](view=n3dview_create.View)  # package Crumple; Opens a Revit view (can also be a sheet).
categories_2 = Categories("OST_StructuralFoundation")
isolateCategoriesTemporary = View.IsolateCategoriesTemporary(view=views_open.active, categories=categories_2)

# group: Output Message
code_block_4 = CodeBlock { "Check"; }
count = List.Count(list=filterByBoolMask_2.in)
count_2 = List.Count(list=filterByBoolMask.in)
eq_3 = count == count_2
code_block_5 = CodeBlock { "All Piles Visible in View."; }
code_block_6 = CodeBlock { " Out of "; }
add = count + code_block_6
code_block_7 = CodeBlock { " piles are visible in view."; }
add_2 = count_2 + code_block_7
add_3 = add + add_2
if_ = RefactoredIf(test=eq_3, true=code_block_5, false=add_3)
code_block_8 = CodeBlock()
# ---------- code_block_8.designscript (2 lines) ----------
"
(Delete this View When Done)";
# ----------------------------------------
add_4 = if_ + code_block_8
ui_messenger = Custom[© UI.Messenger](title=code_block_4, body=add_4)  # package Crumple; Displays a message box with a title/body and OK/cancel button. If OK is selected, the third input's data will be passed through.
