# Dynamo graph script.dyn (Dynamo 2.19.3.6394)
# packages: Crumple 2024.4.3, Genius Loci 2024.2.26, Clockwork for Dynamo 2.x 2.6.0, Data-Shapes 2024.2.114

# group: STEP 0: Get Current Doc Name
current = Document.Current()
filePath = Document.FilePath(document=current)
watch = Watch(filePath)
code_block = CodeBlock { 0; }
string = StringInput("\")
string_2 = StringInput(".rvt")
string_3 = StringInput("")
code_block_2 = CodeBlock { "-S-"; }

# group: Retrieve users autodesk ID from excel file and remove from export
file_path = Filename("\\Cpd.local\s\Standard Details\Revit\5 Revit Extensions and Add-Ins\Craddys in house toolbar\BIM-ToolBar Files\Autodesk Usernames.xlsx")
file_from_path = FileObject(path=file_path)
code_block_3 = CodeBlock { "Sheet1"; }
importExcel = Data.ImportExcel(file=file_from_path, sheetName=code_block_3)
isNull = Object.IsNull(object=importExcel)
code_block_4 = CodeBlock { "_"; }
code_block_5 = CodeBlock { ""; }
if_ = RefactoredIf(test=isNull, true=code_block_5, false=importExcel)
flatten = List.Flatten(list=if_)
add = code_block_4 + flatten
contains = String.Contains(string=filePath, searchFor=add)
filterByBoolMask = List.FilterByBoolMask(list=add, mask=contains)
code_block_6 = CodeBlock { ""; }
replace = String.Replace(string=filePath, searchFor=filterByBoolMask.in, replaceWith=code_block_6)
if_2 = RefactoredIf(test=isNull, true=filePath, false=replace)
watch_2 = Watch(importExcel)
watch_3 = Watch(flatten)
watch_4 = Watch(contains)
watch_5 = Watch(filterByBoolMask.out)
watch_6 = Watch(if_)

# group (continued): STEP 0: Get Current Doc Name
lastIndexOf = String.LastIndexOf(string=if_2, searchFor=string)
code_block_7 = CodeBlock(X=lastIndexOf) { X+1; }
remove = String.Remove(string=if_2, startIndex=code_block, count=code_block_7)
replace_2 = String.Replace(string=remove, searchFor=string_2, replaceWith=string_3)
watch_7 = Watch(replace_2)
watch_8 = Watch(remove)

# group: STEP 2: UI
code_block_8 = CodeBlock { "Prepare Model for Issue?"; }

string_4 = StringInput("Confirm")
code_block_9 = CodeBlock { "Yes"; }
code_block_10 = CodeBlock { "Are you sure?"; }
boolean_input = Custom[Boolean input](InputName=code_block_9, SideText=code_block_10)  # frozen; package Data-Shapes; Creates a boolean input for UI.MultipleInputForm ++ . Check out www.data-shapes.net for more infos!
boolean = BoolSelector(true)
multipleinputform = Custom[MultipleInputForm ++](Description_optional=code_block_8, ButtonText_optional=string_4, Inputs=boolean_input, Toggle=boolean)  # package Data-Shapes; Create a form with multiple inputs. see www.data-shapes.net for tutorials and infos!
code_block_11 = CodeBlock { 0; }
code_block_12 = CodeBlock { 1; }
slice = List.Slice(list=multipleinputform.User_Inputs, start=code_block_11, end=code_block_12)
code_block_13 = CodeBlock(x=slice) { x[0]; }
code_block_14 = CodeBlock { "Complete!"; }
code_block_15 = CodeBlock()
# ---------- code_block_15.designscript (3 lines) ----------
"A stripped model has been saved to your desktop.

You may now close this file.";
# ----------------------------------------
current_2 = Document.Current()

# group: STEP 0: Determine save location
string_5 = StringInput("C:\Users\")
userName = Custom[System.UserName]()  # package Clockwork for Dynamo 2.x; Returns the user name of the person who is currently logged on to Windows on the machine the script is executed on.
add_2 = string_5 + userName
string_6 = StringInput("\Desktop\")
add_3 = add_2 + string_6

flatten_2 = List.Flatten(list=replace_2)
code_block_16 = CodeBlock(x=flatten_2) { x[0]; }
indexOf = String.IndexOf(string=remove, searchFor=code_block_2)
flatten_3 = List.Flatten(list=indexOf)
code_block_17 = CodeBlock(x=flatten_3) { x[0]; }
code_block_18 = CodeBlock { 7; }
add_4 = code_block_17 + code_block_18
code_block_19 = CodeBlock { " "; }
code_block_20 = CodeBlock { " "; }
boolean_2 = BoolSelector(true)
synchronizeWithCentral = Custom[Document.SynchronizeWithCentral](relinquishProjectStandardWorksets=boolean_2, relinquishViewWorksets=boolean_2, relinquishFamilyWorksets=boolean_2, relinquishUserCreatedWorksets=boolean_2, relinquishBorrowedElements=boolean_2, saveLocalFileBeforeSync=boolean_2, runMe=boolean_2)  # package Clockwork for Dynamo 2.x; Synchronizes a workshared model with the central model.

# group: STEP 0: Gather All IDs to Delete
categories = Categories("OST_Views")
all_elements_of_category = ElementsOfCategory(Category=categories)
list_clean = Custom[List Clean](list=all_elements_of_category)  # package Genius Loci; Removes all Null, Empty and Blank from a list or nested list of lists.
name = Element.Name(element=all_elements_of_category)
list_clean_2 = Custom[List Clean](list=name)
string_7 = StringInput("3D Coversheet")
contains_2 = String.Contains(string=list_clean_2, searchFor=string_7)
filterByBoolMask_2 = List.FilterByBoolMask(list=list_clean, mask=contains_2)
watch_9 = Watch(filterByBoolMask_2.in)
watch_10 = Watch(filterByBoolMask_2.out)
categories_2 = Categories("OST_Sheets")
all_elements_of_category_2 = ElementsOfCategory(Category=categories_2)
name_2 = Element.Name(element=all_elements_of_category_2)
string_8 = StringInput("CDY REVIT MODEL COVER SHEET")
contains_3 = String.Contains(string=name_2, searchFor=string_8)
filterByBoolMask_3 = List.FilterByBoolMask(list=all_elements_of_category_2, mask=contains_3)
views_open = Custom[© Views.Open](view=filterByBoolMask_3.in)  # package Crumple; Opens a Revit view (can also be a sheet).
categories_3 = Categories("OST_Schedules")
all_elements_of_category_3 = ElementsOfCategory(Category=categories_3)
name_3 = Element.Name(element=all_elements_of_category_3)
string_9 = StringInput("Revision")
contains_4 = String.Contains(string=name_3, searchFor=string_9)
filterByBoolMask_4 = List.FilterByBoolMask(list=all_elements_of_category_3, mask=contains_4)
categories_4 = Categories("OST_VolumeOfInterest")
all_elements_of_category_4 = ElementsOfCategory(Category=categories_4)
categories_5 = Categories("OST_ReferenceLines")
all_elements_of_category_5 = ElementsOfCategory(Category=categories_5)
current_3 = Document.Current()
collect_cadlinks = Custom[© Collect.CADLinks](docOrLink=current_3)  # package Crumple; Return all CAD linked instances as well as their types and owner views.
collect_cadimports = Custom[© Collect.CADImports](docOrLink=current_3)  # package Crumple; Returns all CAD import instances as well as their type and view.
collect_revitlinks = Custom[© Collect.RevitLinks](docOrLink=current_3)  # package Crumple; Returns all Revit link types in the current document, as well as all instance elements of those types.
list_create = List.Create(item0=filterByBoolMask_2.out, item1=filterByBoolMask_4.out, item2=filterByBoolMask_3.out, item3=all_elements_of_category_4, item4=all_elements_of_category_5, item5=collect_cadlinks.instance, item6=collect_cadimports.instance, item7=collect_revitlinks.linkTypes)
flow_waitfor = Custom[© Flow.WaitFor](data=list_create, waitFor=synchronizeWithCentral)  # package Crumple; Tells the first input to wait for the second input to arrive, then passes on the first input. Really useful for scripts which have branching paths that rely on their outputs to carry each other forward. Quite a few custom packages have a 'passthrough' or 'waitfor' node. I use these all the time, so find it useful to have them contained in this package also.
flatten_4 = List.Flatten(list=flow_waitfor)
watch_11 = Watch(filterByBoolMask_3.in)

# group: STEP 0: Get Current Revision
string_10 = StringInput("Current Revision")
getParameterValueByName = Element.GetParameterValueByName(element=filterByBoolMask_3.in, parameterName=string_10)
watch_12 = Watch(getParameterValueByName)
code_block_21 = CodeBlock(x=watch_12) { x[0]; }

add_5 = code_block_19 + code_block_21
add_6 = add_5 + code_block_20
insert = String.Insert(string=code_block_16, index=add_4, toInsert=add_6)
add_7 = add_3 + insert
code_block_22 = CodeBlock { " COVER SHEET"; }
add_8 = insert + code_block_22
exportPDF = Custom[ExportPDF](DirectoryPath=add_3, view=filterByBoolMask_3.in, Filename=add_8)  # package Genius Loci; Works only in Revit 2022 and later. Exports a selection of views in PDF format.

# group: STEP 1: Delete and deep purge
flow_waitfor_2 = Custom[© Flow.WaitFor](data=flatten_4, waitFor=exportPDF)
delete_elements = Custom[Delete Elements](element=flow_waitfor_2)  # package Genius Loci; Delete the input list of elements from the given Revit document. The node returns the number of successfully deleted elements and their Ids as a string. Based on a Springs node
flow_waitfor_3 = Custom[© Flow.WaitFor](data=flatten_4, waitFor=delete_elements.count)
purge_unused = Custom[Purge Unused](RunIt=flow_waitfor_3, Deeply=flow_waitfor_3)  # package Genius Loci; Purge the document completely including materials an assets using the API. The optional input "deeply" allows to purge unused view templates, unused view filters, imported line Patterns from DWG and "Imports in Families" Object Styles. Can be used with documents open in the background. Works only in Revit 2017 and later.
flow_waitfor_4 = Custom[© Flow.WaitFor](data=flatten_4, waitFor=purge_unused.Count)
current_4 = Document.Current()
code_block_23 = CodeBlock { ""; }
if_3 = If(test=flow_waitfor_4, true=current_4, false=code_block_23)
boolean_3 = BoolSelector(true)
purgeUnused = Document.PurgeUnused(document=if_3, fullPurge=boolean_3)

# group: STEP 4: Combine Names and save as
boolean_4 = BoolSelector(true)
flow_waitfor_5 = Custom[© Flow.WaitFor](data=boolean_4, waitFor=purgeUnused)
saveAs = Custom[Document.SaveAs](filePath=add_7, saveAsCentral=flow_waitfor_5)  # package Clockwork for Dynamo 2.x; Saves the active Revit document under the given name.
watch_13 = Watch(saveAs)

flow_waitfor_6 = Custom[© Flow.WaitFor](data=current_2, waitFor=watch_13)
ui_messenger = Custom[© UI.Messenger](title=code_block_14, body=code_block_15, pass=flow_waitfor_6)  # package Crumple; Displays a message box with a title/body and OK/cancel button. If OK is selected, the third input's data will be passed through.
watch_14 = Watch(indexOf)
watch_15 = Watch(add_6)
watch_16 = Watch(insert)
views_open_2 = Custom[© Views.Open](view=filterByBoolMask_3.in)
watch_17 = Watch(add_8)
watch_18 = Watch(exportPDF)
