# Dynamo graph script.dyn (Dynamo 2.19.3.6394)
# packages: Data-Shapes 2024.2.114, Crumple 2024.4.3, Clockwork for Dynamo 2.x 2.6.0

code_block = CodeBlock { 0; }
boolean = BoolSelector(false)

# group: UI - Choose Doc Reg Parameters
code_block_2 = CodeBlock { "Select DocReg Template"; }
file_path = Filename(".\icon.png")
code_block_3 = CodeBlock { "Confirm"; }
code_block_4 = CodeBlock { ["Standard Parameters","Aldi Parameters"]; }
data_shapes_dropdown_data = Custom[Data-Shapes_DropDown Data](Keys=code_block_4, Values=code_block_4, DefaultValueIndex=code_block, Sorted_optional=boolean)  # package Data-Shapes; Create data for DropDown input in UI.MultiInputForm ++ . Check out www.data-shapes.net for more infos.
boolean_2 = BoolSelector(true)
code_block_5 = CodeBlock { "Cancel"; }
data_shapes_multipleinputform = Custom[Data-Shapes_MultipleInputForm ++](Description_optional=code_block_2, Logo_optional=file_path, ButtonText_optional=code_block_3, Inputs=data_shapes_dropdown_data, Toggle=boolean_2, CancelButtonText_optional=code_block_5)  # package Data-Shapes; Create a form with multiple inputs. see www.data-shapes.net for tutorials and infos!
code_block_6 = CodeBlock(X=data_shapes_multipleinputform.User_Inputs) { X[0]; }
code_block_7 = CodeBlock { "Standard Parameters"; }
operators = code_block_6 == code_block_7

# group: Get project identifier
string = StringInput("Project Information")
byName = Category.ByName(name=string)
all_elements_of_category = ElementsOfCategory(Category=byName)
string_2 = StringInput("Project Number")
code_block_8 = CodeBlock { "-"; }

string_3 = StringInput("PM.Sheet.Title.Number.Project")
if_ = RefactoredIf(test=operators, true=string_2, false=string_3)

# group (continued): Get project identifier
getParameterValueByName = Element.GetParameterValueByName(element=all_elements_of_category, parameterName=if_)
operators_2 = getParameterValueByName + code_block_8
string_from_array = FromArray(array=operators_2)

# group: Get sheets, sort by their number (remove sheets with no revisions)
string_4 = StringInput("Sheets")
byName_2 = Category.ByName(name=string_4)
all_elements_of_category_2 = ElementsOfCategory(Category=byName_2)
sheetNumber = Sheet.SheetNumber(sheet=all_elements_of_category_2)
sortByKey = List.SortByKey(list=all_elements_of_category_2, keys=sheetNumber)
crumple__sheets_revisions = Custom[Crumple_© Sheets.Revisions](sheets=sortByKey.sortedList)  # package Crumple; Given a sheet, returns all revisions associated with that sheet as elements.
isEmpty = List.IsEmpty(list=crumple__sheets_revisions, lacing=Longest)
filterByBoolMask = List.FilterByBoolMask(list=sortByKey.sortedList, mask=isEmpty)

# group: Get full sheet name (Craddys Parameters)
string_5 = StringInput("Originator")
getParameterValueByName_2 = Element.GetParameterValueByName(element=filterByBoolMask.out, parameterName=string_5)
code_block_9 = CodeBlock { "-"; }
string_6 = StringInput("Functional Breakdown")
getParameterValueByName_3 = Element.GetParameterValueByName(element=filterByBoolMask.out, parameterName=string_6)
code_block_10 = CodeBlock { "-"; }
operators_3 = getParameterValueByName_3 + code_block_10
string_7 = StringInput("Spatial Breakdown")
getParameterValueByName_4 = Element.GetParameterValueByName(element=filterByBoolMask.out, parameterName=string_7)
code_block_11 = CodeBlock { "-"; }
operators_4 = getParameterValueByName_4 + code_block_11
string_8 = StringInput("Form")
getParameterValueByName_5 = Element.GetParameterValueByName(element=filterByBoolMask.out, parameterName=string_8)
code_block_12 = CodeBlock { "-"; }
operators_5 = getParameterValueByName_5 + code_block_12
string_9 = StringInput("Discipline")
getParameterValueByName_6 = Element.GetParameterValueByName(element=filterByBoolMask.out, parameterName=string_9)
code_block_13 = CodeBlock { "-"; }
operators_6 = getParameterValueByName_6 + code_block_13
string_10 = StringInput("Classification")
getParameterValueByName_7 = Element.GetParameterValueByName(element=filterByBoolMask.out, parameterName=string_10)

# group: Remove "[" and "]" from string to array conversion
watch = Watch(string_from_array)
code_block_14 = CodeBlock { 0; 1; }
remove = String.Remove(string=watch, startIndex=code_block_14.out0, count=code_block_14.out1)
watch_2 = Watch(remove)
code_block_15 = CodeBlock { -1; 1; }
remove_2 = String.Remove(string=watch_2, startIndex=code_block_15.out0, count=code_block_15.out1)
watch_3 = Watch(remove_2)
operators_7 = watch_3 + getParameterValueByName_2

# group (continued): Get full sheet name (Craddys Parameters)
operators_8 = operators_7 + code_block_9
operators_9 = operators_8 + operators_3
operators_10 = operators_9 + operators_4
operators_11 = operators_10 + operators_5
operators_12 = operators_11 + operators_6
operators_13 = operators_12 + getParameterValueByName_7

# group: Add Blank row to allow for header
code_block_16 = CodeBlock { ""; }
addItemToFront = List.AddItemToFront(item=code_block_16, list=operators_13)

watch_4 = Watch(addItemToFront)

# group: Get full sheet name (Aldi's Parameters)
string_11 = StringInput("PM.Sheet.Title.Creator.Originator")
getParameterValueByName_8 = Element.GetParameterValueByName(element=filterByBoolMask.out, parameterName=string_11)
code_block_17 = CodeBlock { "-"; }
string_12 = StringInput("PM.Sheet.Title.View.Zone")
getParameterValueByName_9 = Element.GetParameterValueByName(element=filterByBoolMask.out, parameterName=string_12)
code_block_18 = CodeBlock { "-"; }
operators_14 = getParameterValueByName_9 + code_block_18
string_13 = StringInput("PM.Sheet.Title.View.Level")
getParameterValueByName_10 = Element.GetParameterValueByName(element=filterByBoolMask.out, parameterName=string_13)
code_block_19 = CodeBlock { "-"; }
operators_15 = getParameterValueByName_10 + code_block_19
string_14 = StringInput("PM.Sheet.Title.View.Type")
getParameterValueByName_11 = Element.GetParameterValueByName(element=filterByBoolMask.out, parameterName=string_14)
code_block_20 = CodeBlock { "-"; }
operators_16 = getParameterValueByName_11 + code_block_20
string_15 = StringInput("PM.Sheet.Title.Creator.Role")
getParameterValueByName_12 = Element.GetParameterValueByName(element=filterByBoolMask.out, parameterName=string_15)
code_block_21 = CodeBlock { "-"; }
operators_17 = getParameterValueByName_12 + code_block_21
string_16 = StringInput("Classification")
getParameterValueByName_13 = Element.GetParameterValueByName(element=filterByBoolMask.out, parameterName=string_16)

operators_18 = watch_3 + getParameterValueByName_8

# group (continued): Get full sheet name (Aldi's Parameters)
operators_19 = operators_18 + code_block_17
operators_20 = operators_19 + operators_14
operators_21 = operators_20 + operators_15
operators_22 = operators_21 + operators_16
operators_23 = operators_22 + operators_17
operators_24 = operators_23 + getParameterValueByName_13

# group: Add Blank row to allow for header
code_block_22 = CodeBlock { ""; }
addItemToFront_2 = List.AddItemToFront(item=code_block_22, list=operators_24)

watch_5 = Watch(addItemToFront_2)

# group (continued): UI - Choose Doc Reg Parameters
if_2 = If(test=operators, true=watch_4, false=watch_5)
watch_6 = Watch(if_2)

# group: Make doctrans
python_script_make_doctrans = Python(IN[0]=filterByBoolMask.out)  # IronPython2; graph output
# ---------- python_script_make_doctrans.python (200 lines) ----------
# Boilerplate text
import clr

clr.AddReference("RevitServices")
import RevitServices
from RevitServices.Persistence import DocumentManager 

clr.AddReference("RevitAPI")
import Autodesk 
from Autodesk.Revit.DB import *

# Current doc/app/ui
doc = DocumentManager.Instance.CurrentDBDocument

# Define list/unwrap list functions
def uwlist(input):
    result = input if isinstance(input, list) else [input]
    return UnwrapElement(result)

# Preparing input from dynamo to revit
sheets = uwlist(IN[0])

# Get revision sequences and revisions
revSeqs = FilteredElementCollector(doc).OfClass(RevisionNumberingSequence).ToElements()
revIds  = Revision.GetAllRevisionIds(doc)
revs    = [doc.GetElement(i) for i in revIds]

AllDates = []
DeDupDates = []
for r in revs:
	AllDates += [r.RevisionDate]
	if r.RevisionDate not in DeDupDates:
		DeDupDates += [r.RevisionDate]
		
NonUniqueDates = []
indexx = 0
for r in revs:
	
	if indexx == 0:
		indexx += 1
		continue
		
	if r.RevisionDate == revs[indexx -1].RevisionDate:
		if r.RevisionDate not in NonUniqueDates:
			NonUniqueDates += [r.RevisionDate] 
	indexx += 1

# Empty variable lists to store to
revSeqNames, revCharSeqs = [],[]

# Get sequence names and characters
for r in revs:
	# Get sequence
	rsId = r.RevisionNumberingSequenceId
	rs   = doc.GetElement(rsId)
	# Append the name and start a sequence
	revSeqNames.append(rs.Name)
	charSequence = []
	# Get sequence characters for numeric...
	if rs.NumberType == RevisionNumberType.Numeric:
		settings  = rs.GetNumericRevisionSettings()
		minDigits = settings.MinimumDigits
		prefix    = settings.Prefix
		suffix    = settings.Suffix
		for n in range(settings.StartNumber,99,1):
			char_str = str(n)
			pad_str  = char_str.rjust(minDigits,"0")
			char_seq = prefix + pad_str + suffix
			charSequence.append(char_seq)
	# ... or Alphanumeric
	else:
		settings = rs.GetAlphanumericRevisionSettings()
		prefix    = settings.Prefix
		suffix    = settings.Suffix
		for a in settings.GetSequence():
			char_seq = prefix + a + suffix
			charSequence.append(char_seq)
	# Append the character sequence
	revCharSeqs.append(charSequence)

# Get revision sequences per sheet
rowsOut = []
sep = "\t"

SeqNo = 0
SeqDate = 0

for s in sheets:
	trackRevs = []
	sheetRevs = s.GetAllRevisionIds()
	rowOut = ""
	rowOut += s.SheetNumber + sep + s.Name + sep
	# For each revision in the document
	for i in revIds:
		# Check if the sheet has it
		DupeDateCounter = 0
		if i in sheetRevs:
			# Get the sequence Id name and get its name
			r    = doc.GetElement(i)
			rsId = r.RevisionNumberingSequenceId
			rs   = doc.GetElement(rsId)
			rsn  = rs.Name
			# Find the index of the sequence name
			i_sq = revSeqNames.index(rsn)
			# Find out how many times the sequence occured so far
			i_ch = trackRevs.count(rsn)
			# Find Seq no, revision date and reset ArtLocation to =
			SeqNo = r.SequenceNumber
			SeqDate = r.RevisionDate 
			ArtificialLocation = 0
			# Then track the sequence
			trackRevs.append(rsn)			
            
			# Check if sequence is a duplicated date
			if SeqDate in NonUniqueDates:
				#DupeDateCounter += 1
				# Find location of SeqDate in DeDupDates List. Set as ArtLocation 
				ArtificialLocation = DeDupDates.index(SeqDate)
				# Find location of last SeqDate in DeDupDates List.
				LastDupDateLocation = len(AllDates) - 1 - AllDates[::-1].index(SeqDate)
				# Add 1 because Seq start at 1, however Python Index start at 0
				ArtificialLocation += 1
				LastDupDateLocation += 1
				# Check if first occurance of dupe date
				if ArtificialLocation == SeqNo - DupeDateCounter:
					# true
					# Get the sequence character, then track the sequence
					d = revCharSeqs[i_sq][i_ch] #+ sep
					#increment dupe counter
					DupeDateCounter += 1
				else:
					#false
					d += ""

				#check if last occurance of dupe date
				if LastDupDateLocation == SeqNo - DupeDateCounter:
					# no output
					d = revCharSeqs[i_sq][i_ch] + sep
					DupeDateCounter += 1
				else:
					d = revCharSeqs[i_sq][i_ch]
					#increment dupe counter
					DupeDateCounter += 1
			else: 
				# If date is not a dupe date	
				# Get the sequence character, then track the sequence	
				d = revCharSeqs[i_sq][i_ch] + sep
		else:
			# Get the sequence Id name and get its name
			r    = doc.GetElement(i)
			rsId = r.RevisionNumberingSequenceId
			rs   = doc.GetElement(rsId)
			rsn  = rs.Name
			# Find Seq no, revision date and reset ArtLocation to =
			SeqNo = r.SequenceNumber
			SeqDate = r.RevisionDate 
			ArtificialLocation = 0
			LastDupDateLocation = 0
			# Then track the sequence
			if SeqDate in NonUniqueDates:
				#DupeDateCounter += 1
				# Find location of SeqDate in DeDupDates List. Set as ArtLocation 
				ArtificialLocation = DeDupDates.index(SeqDate)
				LastDupDateLocation = len(AllDates) - 1 - AllDates[::-1].index(SeqDate)
				# Add 1 because Seq start at 1, however Python Index start at 0
				ArtificialLocation += 1
				LastDupDateLocation += 1
				# Check if first occurance of dupe date
				if ArtificialLocation == SeqNo - DupeDateCounter:
					# true
					d = ""
					#increment dupe counter
					DupeDateCounter += 1
				else:
					# no output
					d = ""
				
				if LastDupDateLocation == SeqNo - DupeDateCounter:
					# no output
					d = "" + sep
					DupeDateCounter += 1
				else:
					d = "" #+ sep
					DupeDateCounter += 1
			else:
			# If Rev not on sheet, no output + tab
				d = "" + sep
		if d != "":
		    rowOut += d 
	# Add the value to the end
	rowsOut.append(rowOut)


# Make the top header
#header = "Document No." + sep + "Document Name" + sep + sep.join([r.RevisionDate for r in revs]) + sep
header = "Document No." + sep + "Document Name" + sep + sep.join(DeDupDates) + sep
rowsOut.insert(0,header)

# Preparing output to Dynamo
OUT = rowsOut
# ----------------------------------------

# group: Prefix sheet number with drawing number
operators_25 = watch_6 + python_script_make_doctrans

watch_7 = Watch(operators_25)
watch_8 = Watch(python_script_make_doctrans)

# group: Join and send to clipboard
string_17 = StringInput("\n")
join = String.Join(separator=string_17, string0=operators_25)
crumple__windows_clipboardsend = Custom[Crumple_© Windows.ClipboardSend]()  # package Crumple; Attempts to send data to the clipboard.; unwired: dataToCopy

sendTo = Custom[Clipboard.SendTo](str=join)  # package Clockwork for Dynamo 2.x; Copies a string to the clipboard.

# group: UI - Success or Cancelled?
boolean_3 = BoolSelector(true)
boolean_4 = BoolSelector(false)
was_process_cancelled = If(test=data_shapes_multipleinputform.Was_Cancelled, true=boolean_3, false=boolean_4)
watch_9 = Watch(was_process_cancelled)
code_block_23 = CodeBlock { "DocReg Exporter"; }
code_block_24 = CodeBlock { "Process Cancelled by User."; }
code_block_25 = CodeBlock { "DocReg Exported to Clipboard."; }
if_3 = If(test=was_process_cancelled, true=code_block_24, false=code_block_25)
crumple__ui_messenger = Custom[Crumple_© UI.Messenger](title=code_block_23, body=if_3, pass=sendTo)  # package Crumple; Displays a message box with a title/body and OK/cancel button. If OK is selected, the third input's data will be passed through.
