# Dynamo graph script.dyn (Dynamo 2.19.3.6394)
# packages: Crumple 2024.4.3, Genius Loci 2024.2.26, Data-Shapes 2024.2.114, Data-Shapes 2025.3.118

element_by_id = ElementById()  # frozen; unwired: Id

# group: Order Piles by X and Y co-ordinates (by survey point) - NOTUSED
getLocation = Element.GetLocation(element=element_by_id)
convert_from_internalorigin = Custom[Convert from InternalOrigin CoordinateSystem](point=getLocation)  # package Genius Loci; Get the location point in the 3 coordinate systems : Shared Coordinates, Project Coordinates, Relative Origin Coordinates.
Y = Point.Y(point=convert_from_internalorigin.Point_Survey_System)
number = DoubleInput(3)
round = Math.Round(number=Y, digits=number)
sortByKey = List.SortByKey(list=element_by_id, keys=round)
groupByKey = List.GroupByKey(list=sortByKey.sortedList, keys=sortByKey.sortedKeys)
reverse = List.Reverse(list=groupByKey.groups)
getLocation_2 = Element.GetLocation(element=reverse)
convert_from_internalorigin_2 = Custom[Convert from InternalOrigin CoordinateSystem](point=getLocation_2)
X = Point.X(point=convert_from_internalorigin_2.Point_Survey_System)
number_2 = DoubleInput(3)
round_2 = Math.Round(number=X, digits=number_2)
sortByKey_2 = List.SortByKey(list=reverse, keys=round_2, lacing=Shortest)  # frozen

code_block = CodeBlock { 0; }
code_block_2 = CodeBlock { 2; }
code_block_3 = CodeBlock { ""; }
code_block_4 = CodeBlock { "Starting No."; "1"; }
textbox_data = Custom[TextBox Data](InputName=code_block_4.out0, DefaultText=code_block_4.out1)  # package Data-Shapes; Create Data for TextBox input in UI.MultipleInputForm ++ . Check out www.data-shapes.net for more informations
file_path = Filename(".\Pile Numbering Guidance Doc.docx")
code_block_5 = CodeBlock { "Cancel"; }
code_block_6 = CodeBlock { 0; }
code_block_7 = CodeBlock { 1; }

# group: Search for Parameter
code_block_8 = CodeBlock { "Pile Category"; }

code_block_9 = CodeBlock { "Element Renumbering"; }
boolean = BoolSelector(true)
boolean_2 = BoolSelector(false)
code_block_10 = CodeBlock { "Process Cancelled by User!"; }
code_block_11 = CodeBlock { " elements successfully renumbered"; }
code_block_12 = CodeBlock { 3; }
code_block_13 = CodeBlock { 4; }

# group: Collect all "STRUCTURAL FOUNDATIONS"
categories = Categories("OST_StructuralColumns")
all_elements_of_category = ElementsOfCategory(Category=categories)

# group: Collect all "STRUCTURAL FOUNDATIONS" > Filter only foundations with TYPE NAME "Pile"
name = Element.Name(element=all_elements_of_category)
string = StringInput("KP")

substring = String.Substring(string=name, startIndex=code_block, length=code_block_2)

# group (continued): Collect all "STRUCTURAL FOUNDATIONS"
eq = substring == string

# group (continued): Collect all "STRUCTURAL FOUNDATIONS" > Filter only foundations with TYPE NAME "Pile"
filterByBoolMask = List.FilterByBoolMask(list=all_elements_of_category, mask=eq)

flatten = List.Flatten(list=filterByBoolMask.in)

# group: First Selection - Drop Down
code_block_14 = CodeBlock { "Pile Category - SET TO ALL"; }
string_2 = StringInput("ALL")
string_3 = StringInput("Pile Category")
getParameterValueByName = Element.GetParameterValueByName(element=filterByBoolMask.in, parameterName=string_3)
uniqueItems = List.UniqueItems(list=getParameterValueByName)
sort = List.Sort(list=uniqueItems)
join = List.Join(list0=string_2, list1=sort)
number_3 = DoubleInput(600)
watch = Watch(join)

eq_2 = join == code_block_3
watch_2 = Watch(eq_2)
filterByBoolMask_2 = List.FilterByBoolMask(list=join, mask=watch_2)
watch_3 = Watch(filterByBoolMask_2.out)
dropdown_data = Custom[DropDown Data](InputName=code_block_14, Keys=watch_3, Values=watch_3)  # package Data-Shapes; Create data for DropDown input in UI.MultiInputForm ++ . Check out www.data-shapes.net for more infos.

# group: User Interface + extract user input
code_block_15 = CodeBlock { "Element Renumber Tool."; }
code_block_16 = CodeBlock { "Confirm"; }
code_block_17 = CodeBlock { "Prefix"; "P"; }
textbox_data_2 = Custom[TextBox Data](InputName=code_block_17.out0, DefaultText=code_block_17.out1)
code_block_18 = CodeBlock { "No. Padding"; "3"; }
textbox_data_3 = Custom[TextBox Data](InputName=code_block_18.out0, DefaultText=code_block_18.out1)
list_create = List.Create(item0=dropdown_data, item1=textbox_data_2, item2=textbox_data_3, item3=textbox_data)
boolean_3 = BoolSelector(true)
multipleinputform = Custom[MultipleInputForm ++](Description_optional=code_block_15, ButtonText_optional=code_block_16, Inputs=list_create, Toggle=boolean_3, LinkToHelp_optional=file_path, CancelButtonText_optional=code_block_5)  # package Data-Shapes; Create a form with multiple inputs. see www.data-shapes.net for tutorials and infos!
watch_4 = Watch(multipleinputform.User_Inputs)
code_block_19 = CodeBlock { 2; }
code_block_20 = CodeBlock { 3; }
slice = List.Slice(list=watch_4, start=code_block_19, end=code_block_20)
watch_5 = Watch(slice)
code_block_21 = CodeBlock(X=watch_5) { X[0]; }
watch_6 = Watch(code_block_21)
toNumber = String.ToNumber(string=watch_6)
code_block_22 = CodeBlock { 1; }
code_block_23 = CodeBlock { 2; }
slice_2 = List.Slice(list=watch_4, start=code_block_22, end=code_block_23)
watch_7 = Watch(slice_2)
code_block_24 = CodeBlock(X=watch_7) { X[0]; }
watch_8 = Watch(code_block_24)
length = String.Length(string=watch_8)
add = length + toNumber

slice_3 = List.Slice(list=watch_4, start=code_block_6, end=code_block_7)

# group (continued): Collect all "STRUCTURAL FOUNDATIONS"
getParameterValueByName_2 = Element.GetParameterValueByName(element=filterByBoolMask.in, parameterName=code_block_8)
contains = String.Contains(string=getParameterValueByName_2, searchFor=slice_3, lacing=Longest)

# group: CHECK IF "ALL"
string_4 = StringInput("ALL")
eq_3 = string_4 == slice_3
eq_4 = filterByBoolMask.in == filterByBoolMask.in
flow_waitfor = Custom[© Flow.WaitFor](data=contains, waitFor=eq_3)  # package Crumple; Tells the first input to wait for the second input to arrive, then passes on the first input. Really useful for scripts which have branching paths that rely on their outputs to carry each other forward. Quite a few custom packages have a 'passthrough' or 'waitfor' node. I use these all the time, so find it useful to have them contained in this package also.
if_ = RefactoredIf(test=eq_3, true=eq_4, false=flow_waitfor)

flatten_2 = List.Flatten(list=if_)

# group (continued): Collect all "STRUCTURAL FOUNDATIONS"
filterByBoolMask_3 = List.FilterByBoolMask(list=flatten, mask=flatten_2)
familytype_name = Custom[© FamilyType.Name](familyTypes=filterByBoolMask_3.in)  # package Crumple; For a family type or list of family types, returns the type names.
id = Element.Id(element=filterByBoolMask_3.in)

if_2 = If(test=multipleinputform.Was_Cancelled, true=boolean, false=boolean_2)
element_by_id_2 = ElementById(Id=id)

# group: Order Piles by X and Y co-ordinates (by basepoint)
getLocation_3 = Element.GetLocation(element=element_by_id_2)
Y_2 = Point.Y(point=getLocation_3)
number_4 = DoubleInput(3)
round_3 = Math.Round(number=Y_2, digits=number_4)
sortByKey_3 = List.SortByKey(list=element_by_id_2, keys=round_3)
groupByKey_2 = List.GroupByKey(list=sortByKey_3.sortedList, keys=sortByKey_3.sortedKeys)
reverse_2 = List.Reverse(list=groupByKey_2.groups)
getLocation_4 = Element.GetLocation(element=reverse_2)
X_2 = Point.X(point=getLocation_4)
number_5 = DoubleInput(3)
round_4 = Math.Round(number=X_2, digits=number_5)
sortByKey_4 = List.SortByKey(list=reverse_2, keys=round_4, lacing=Shortest)

flatten_3 = List.Flatten(list=sortByKey_4.sortedList)
slice_4 = List.Slice(list=watch_4, start=code_block_12, end=code_block_13)
watch_9 = Watch(slice_4)
code_block_25 = CodeBlock(X=watch_9) { X[0]; }
watch_10 = Watch(code_block_25)
toNumber_2 = String.ToNumber(string=watch_10)

# group: Add Prefix and padding (P00X)
flatten_4 = List.Flatten(list=flatten_3)
count = List.Count(list=flatten_4)
string_5 = StringInput("Mark")
add_2 = count + toNumber_2
code_block_26 = CodeBlock(a=toNumber_2, c=add_2) { (a..c)+""; }
code_block_27 = CodeBlock { "0"; }
padLeft = String.PadLeft(string=code_block_26, newLength=toNumber, padChars=code_block_27)
padLeft_2 = String.PadLeft(string=padLeft, newLength=add, padChars=watch_8)
setParameterByName = Element.SetParameterByName(element=flatten_4, parameterName=string_5, value=padLeft_2)
watch_11 = Watch(count)
watch_12 = Watch(code_block_26)

add_3 = count + code_block_11
if_3 = If(test=if_2, true=code_block_10, false=add_3)
ui_messenger = Custom[© UI.Messenger](title=code_block_9, body=if_3, pass=setParameterByName)  # package Crumple; Displays a message box with a title/body and OK/cancel button. If OK is selected, the third input's data will be passed through.
watch_13 = Watch(code_block_26)
watch_14 = Watch(flatten)
watch_15 = Watch(flatten_2)
watch_16 = Watch(filterByBoolMask_3.in)
