# Dynamo graph script.dyn (Dynamo 2.10.1.3976)
# packages: Data-Shapes 2024.2.114, Crumple 2024.4.3

# group: Get Elements in view
views = Views("3D Coversheet")
all_elements_in_view_s = Custom[All Elements In View(s)](Views=views)  # package Data-Shapes; Retrieves all visible element in a view or a set of views

# group: Filter out groups
string_from_object = FromObject(object=all_elements_in_view_s)
code_block = CodeBlock { "Group"; }
contains = String.Contains(str=string_from_object, searchFor=code_block)
filterByBoolMask = List.FilterByBoolMask(list=all_elements_in_view_s, mask=contains)
watch = Watch(filterByBoolMask.out)
watch_2 = Watch(filterByBoolMask.in)

code_block_2 = CodeBlock { FILTERED OUT GROUP... BUT ELEMENTS IN GROUP ARNT FILTERED. FIND WAY TO FIX. FOR NOW BEFORE RUNNING COMMAND, DESELECT ALL GROUP WITHIN REVIT BY USING FILTER; }
code_block_3 = CodeBlock { "Success!"; }
code_block_4 = CodeBlock { "Analyical Model Successfully Disabled."; }

# group: Switch off Analytical
code_block_5 = CodeBlock { "Enable Analytical Model"; }
code_block_6 = CodeBlock { 0; }
setParameterByName = Element.SetParameterByName(element=filterByBoolMask.out, parameterName=code_block_5, value=code_block_6)

ui_messenger = Custom[© UI.Messenger](title=code_block_3, body=code_block_4, pass=setParameterByName)  # package Crumple; Displays a message box with a title/body and OK/cancel button. If OK is selected, the third input's data will be passed through.
